# Grasshopper definition OpenAI_beta_ohe.gh (Grasshopper 1.0.7)
# plug-ins: LadybugGrasshopper

# ----
# Chatgpt 4 - Text generation
panel = Panel("xxxx")
lb_falsestarttoggle = LBFalseStartToggle(False)
ghpython_script = GhPythonScript(run=lb_falsestarttoggle, api_key=panel, prompt="What's the capital of Venezuela?")  # -> out, answer
# ---------- ghpython_script: Python ----------
import System
import clr
clr.AddReference('System.Net.Http')
clr.AddReference('System.Web.Extensions')
from System.Net.Http import HttpClient, HttpRequestMessage, HttpMethod, StringContent
from System.Net.Http.Headers import MediaTypeHeaderValue
from System.Text import Encoding
from System.Threading.Tasks import Task
from System.Web.Script.Serialization import JavaScriptSerializer

# Only run the script if 'run' is set to True
if run:
    # Initialize the HTTP client
    client = HttpClient()
    
    # Set up the request for the chat completions endpoint
    request = HttpRequestMessage(HttpMethod.Post, "https://api.openai.com/v1/chat/completions")
    request.Headers.Authorization = System.Net.Http.Headers.AuthenticationHeaderValue("Bearer", api_key)

    # Prepare the data as a dictionary and serialize to JSON
    # Adjust the payload for the chatgpt-4 model
    data = {
        "model": "gpt-4",  # Specify the model you want to use
        "messages": [{"role": "system", "content": "You are a helpful assistant."}, {"role": "user", "content": prompt}]
    }
    serializer = JavaScriptSerializer()
    json_data = serializer.Serialize(data)

    request.Content = StringContent(json_data, Encoding.UTF8, "application/json")
    
    # Send the request and get the response
    response = client.SendAsync(request).Result
    content = response.Content.ReadAsStringAsync().Result
    
    # Check the status code
    if not response.IsSuccessStatusCode:
        answer = "Error: {0}\n{1}".format(response.StatusCode, content)
    else:
        # Deserialize the JSON response
        answer_data = serializer.Deserialize[dict](content)
        
        # Access the response data
        if "choices" in answer_data and len(answer_data["choices"]) > 0 and "message" in answer_data["choices"][0]:
            answer = answer_data["choices"][0]["message"]["content"]
        else:
            answer = "No answer found or an error occurred."
else:
    answer = None

# Assign the output to the 'answer' variable
# ---------- end ghpython_script ----------
panel_2 = Panel(ghpython_script.answer)

file_path = FilePath()

# ----
# Chatgpt 4 Vision
panel_3 = Panel("xxx")
lb_falsestarttoggle_2 = LBFalseStartToggle(False)
ghpython_script_2 = GhPythonScript(run=lb_falsestarttoggle_2, api_key=panel_3, prompt="What is in the image?", filePath=file_path)  # -> out, answer
# ---------- ghpython_script_2: Python ----------
import System
import clr
clr.AddReference('System.Net.Http')
clr.AddReference('System.Web.Extensions')
from System.IO import FileStream, FileMode, FileAccess
from System.Net.Http import HttpClient, HttpRequestMessage, HttpMethod, StringContent
from System.Web.Script.Serialization import JavaScriptSerializer

# Function to encode the image
def encode_image(image_path):
    # Ensure the path is in the correct format
    image_path = image_path.replace("\\", "\\\\")
    try:
        with FileStream(image_path, FileMode.Open, FileAccess.Read) as image_file:
            bytes = System.Array.CreateInstance(System.Byte, image_file.Length)
            image_file.Read(bytes, 0, int(image_file.Length))
            return System.Convert.ToBase64String(bytes)
    except Exception as e:
        return "Error encoding image: " + str(e)

# Only run the script if 'run' is set to True
if run and filePath and api_key:
    # Get the base64 string of the image
    base64_image = encode_image(filePath)
    
    if base64_image.startswith("Error"):
        # There was an issue encoding the image, output the error message
        answer = base64_image
    else:
        # Initialize the HTTP client
        client = HttpClient()
        
        # Set up the request for the GPT-4 model
        request = HttpRequestMessage(HttpMethod.Post, "https://api.openai.com/v1/chat/completions")
        request.Headers.Authorization = System.Net.Http.Headers.AuthenticationHeaderValue("Bearer", api_key)
        
        # Prepare the data as a dictionary and serialize to JSON
        data = {
            "model": "gpt-4-vision-preview",  # Replace with your chosen model
            "messages": [
                {
                    "role": "user",
                    "content": [
                        {
                            "type": "text",
                            "text": prompt
                        },
                        {
                            "type": "image_url",
                            "image_url": "data:image/png;base64,{0}".format(base64_image)
                        }
                    ]
                }
            ],
            "max_tokens": 300
        }
        serializer = JavaScriptSerializer()
        json_data = serializer.Serialize(data)

        request.Content = StringContent(json_data, System.Text.Encoding.UTF8, "application/json")
        
        # Send the request and get the response
        response = client.SendAsync(request).Result
        content = response.Content.ReadAsStringAsync().Result
        
        # Check the status code and parse the response
        if not response.IsSuccessStatusCode:
            answer = "HTTP Error: {0}\n{1}".format(response.StatusCode, content)
        else:
            # Deserialize the JSON response
            answer_data = serializer.Deserialize[dict](content)
            
            # Access the response data
            if "choices" in answer_data and len(answer_data["choices"]) > 0 and "message" in answer_data["choices"][0]:
                answer = answer_data["choices"][0]["message"]["content"]
            else:
                answer = "No answer found or an error occurred."
else:
    answer = "Set 'run' to True and provide a valid image file path and API key."

# Assign the output to the 'answer' variable
# ---------- end ghpython_script_2 ----------
panel_4 = Panel(ghpython_script_2.answer)
